# Grasshopper definition HoppedUp_A_01_HelloWorld.gh (Grasshopper 1.0.7)
# plug-ins: Bifocals

panel = Panel()
get_string = GetString(panel, AtLeast=1, AtMost=1)

# ---- group: RH_OUT:A_01_HelloWorld
a_01_helloworld = A_01_HelloWorld(x=get_string)  # -> out, A; inputs x: String
# ---------- a_01_helloworld: C# usings ----------
using System.IO;
using System.Linq;
using System.Data;
using System.Drawing;
using System.Reflection;
using System.Windows.Forms;
using System.Xml;
using System.Xml.Linq;
using System.Runtime.InteropServices;

using Rhino.DocObjects;
using Rhino.Collections;
using GH_IO;
using GH_IO.Serialization;
# ---------- a_01_helloworld: C# ----------
    Print(x);
# ---------- end a_01_helloworld ----------

# ----
panel_2 = Panel(a_01_helloworld.out)
