# Grasshopper definition HoppedUp_A_02_FormatString.gh (Grasshopper 1.0.7)

doublex = GetNumber(Slider(0, range=0..10), AtLeast=1, AtMost=1, Maximum=1.797693135e+308, Minimum=-1.797693135e+308)
doubley = GetNumber(Slider(0, range=0..10), AtLeast=1, AtMost=1, Maximum=1.797693135e+308, Minimum=-1.797693135e+308)
a_02_formatstring = A_02_FormatString(x=doublex, y=doubley)  # -> out, A; inputs x: Double, y: Double
# ---------- a_02_formatstring: C# usings ----------
using System.IO;
using System.Linq;
using System.Data;
using System.Drawing;
using System.Reflection;
using System.Windows.Forms;
using System.Xml;
using System.Xml.Linq;
using System.Runtime.InteropServices;

using Rhino.DocObjects;
using Rhino.Collections;
using GH_IO;
using GH_IO.Serialization;
# ---------- a_02_formatstring: C# ----------
    Print("x: {0}; y: {1:.00}", x, y);   //{1:.000} means that a number will be always displayed with 3 decimal places
    //(could be {1:0.00} for two places aswell). Useful eg. for pretty area display.
# ---------- end a_02_formatstring ----------

# ---- group: RH_OUT:text
text = Text(a_02_formatstring.out)

# ----
panel = Panel(text)
