# Grasshopper definition HoppedUp_A_03_CultureInfoFormat.gh (Grasshopper 1.0.7)

doublex = GetNumber(Slider(0, range=0..10), AtLeast=1, AtMost=1, Maximum=1.797693135e+308, Minimum=-1.797693135e+308)
doubley = GetNumber(Slider(0, range=0..10), AtLeast=1, AtMost=1, Maximum=1.797693135e+308, Minimum=-1.797693135e+308)
a_04_formatlistandoutput = A_04_FormatListAndOutput()  # -> out, formattedText; inputs areasAsNumbers: list of Double
# ---------- a_04_formatlistandoutput: C# ----------
    List<string> areasAsText = new List<string>();
    for(int i = 0; i < areasAsNumbers.Count; i++){
      areasAsText.Add(string.Format("area[{0}]: {1:0.00}m²", i, areasAsNumbers[i]) );
      // "{0}" is swapped with the first argument after text string -> i
      // "{1}" is swapped with the second argument after text string -> areasAsNumbers[i] (i-th element of areas list)
    }
    
    formattedText = areasAsText; //outputting whole list
# ---------- end a_04_formatlistandoutput ----------

# ---- group: RH_OUT:A_03_CultureInfoFormat
a_03_cultureinfoformat = A_03_CultureInfoFormat(x=doublex, y=doubley)  # -> out, A; inputs x: Double, y: Double
# ---------- a_03_cultureinfoformat: C# ----------
    System.Globalization.CultureInfo uk = System.Globalization.CultureInfo.GetCultureInfo("en-GB");
    string formatted = string.Format(uk, "x: {0:P2}; y: {1:C2}", x, y);
    //P means percent and C means currency.
    // Following number stands for number of decimal places you want to show
    Print(formatted);
# ---------- end a_03_cultureinfoformat ----------

# ----
panel = Panel(a_03_cultureinfoformat.out)
