# Grasshopper definition HoppedUp_A_04_FormatListAndOutput.gh (Grasshopper 1.0.7)

listofnums = GetNumber(
    [Slider(0, range=0..10), Slider(1.84, range=0..10)],
    AtLeast=1,
    AtMost=1,
    Maximum=1.797693135e+308,
    Minimum=-1.797693135e+308)

# ---- group: RH_OUT:A_04_FormatListAndOutput
a_04_formatlistandoutput = A_04_FormatListAndOutput(areasAsNumbers=listofnums)  # -> out, formattedText; inputs areasAsNumbers: list of Double
# ---------- a_04_formatlistandoutput: C# usings ----------
using System.IO;
using System.Linq;
using System.Data;
using System.Drawing;
using System.Reflection;
using System.Windows.Forms;
using System.Xml;
using System.Xml.Linq;
using System.Runtime.InteropServices;

using Rhino.DocObjects;
using Rhino.Collections;
using GH_IO;
using GH_IO.Serialization;
# ---------- a_04_formatlistandoutput: C# ----------
    List<string> areasAsText = new List<string>();
    for(int i = 0; i < areasAsNumbers.Count; i++){
      areasAsText.Add(string.Format("area[{0}]: {1:0.00}m²", i, areasAsNumbers[i]));
      // "{0}" is swapped with the first argument after text string -> i
      // "{1}" is swapped with the second argument after text string -> areasAsNumbers[i] (i-th element of areas list)
    }

    formattedText = areasAsText; //outputting whole list
# ---------- end a_04_formatlistandoutput ----------

# ----
panel = Panel(a_04_formatlistandoutput.formattedText)
