# Grasshopper definition HoppedUp_A_05_Comments.gh (Grasshopper 1.0.7)

get_string = GetString("this is just for learning about how to comment out text", AtLeast=1, AtMost=1)
a_05_comments = A_05_Comments(comment=get_string)  # -> out, A; inputs comment: String
# ---------- a_05_comments: C# usings ----------
using System.IO;
using System.Linq;
using System.Data;
using System.Drawing;
using System.Reflection;
using System.Windows.Forms;
using System.Xml;
using System.Xml.Linq;
using System.Runtime.InteropServices;

using Rhino.DocObjects;
using Rhino.Collections;
using GH_IO;
using GH_IO.Serialization;
# ---------- a_05_comments: C# ----------
    Print(comment);
    // a single line comment

    /*
    a multi
    line
    comment
    */

    /* Everything written as a commentary is ommited */

    // Comments should be used when needed and not too obvious
    //int i = 0; //declaring variable i   ->  why write that? It's obvious
# ---------- end a_05_comments ----------

# ---- group: RH_OUT:text
text = Text(a_05_comments.out)

# ----
panel = Panel(text)
