# Grasshopper definition HoppedUp_B_01_BasicDataTypes.gh (Grasshopper 1.0.7)

panel = Panel()
default_string = GetString(panel, AtLeast=1, AtMost=1)
b_01_basicdatatypes = B_01_BasicDataTypes(x=default_string)  # -> out, A; inputs x: String
# ---------- b_01_basicdatatypes: C# ----------
    int myInt = 0;
    int i=0, j = 1, k = 2;
    int otherInt;             //declaration without initialization - reserving memory, creating a blueprint for data
    otherInt = -10;           //initialization

    double myDouble = 0;
    double a, b, c;
    a = 10.3;
    b = -124.4;
    c = Math.PI;

    bool condition = false;   //can only be true or false
    bool flag = true;


    Print("myInt: {0} \ni: {1}, j:{2}, k:{3}", myInt, i, j, k);  //special character '/n' means new line
    Print("otherInt: " + otherInt.ToString());
    Print("myDouble: " + myDouble.ToString());
    Print("a: {0}, b: {1}, c: {2}", a, b, c);
    //when you use formatted string, ToString() method is automatically called for every argument
    Print("condition: " + condition.ToString() + "\n" + "flag: " + flag.ToString()); // '/n' once again
# ---------- end b_01_basicdatatypes ----------

# ---- group: RH_OUT:data_types
text = Text(b_01_basicdatatypes.out)

# ----
panel_2 = Panel(text)
