# Grasshopper definition HoppedUp_B_01_InputOutputData.gh (Grasshopper 1.0.7)

int = GetInteger(Slider(2, range=0..10), AtLeast=1, AtMost=1, Maximum=2147483647, Minimum=-2147483648)
double = GetNumber(Slider(2.85, range=0..10), AtLeast=1, AtMost=1, Maximum=1.797693135e+308, Minimum=-1.797693135e+308)
bool = GetInteger(Slider(1, range=0..1), AtLeast=1, AtMost=1, Maximum=2147483647, Minimum=-2147483648)
b_01_inputoutputdata = B_01_InputOutputData(x=int, y=double, z=bool)  # -> out, A, B, C; inputs x: Int32, y: Double, z: Boolean
# ---------- b_01_inputoutputdata: C# ----------
    A = x;
    B = y;
    C = z;
# ---------- end b_01_inputoutputdata ----------

# ---- group: RH_OUT:int
integer = Integer(b_01_inputoutputdata.A)

# ---- group: RH_OUT:double
number = Number(b_01_inputoutputdata.B)

# ---- group: RH_OUT:bool
boolean = Boolean(b_01_inputoutputdata.C)

# ----
panel = Panel([integer, number, boolean])
