# Grasshopper definition HoppedUp_B_03_RangesOfNumericDataTypes.gh (Grasshopper 1.0.7)

panel = Panel()
default_string = GetString(panel, AtLeast=1, AtMost=2147483647)
b_03_rangesofnumericdatatypes = B_03_RangesOfNumericDataTypes(str=default_string)  # -> out, A; inputs str: String
# ---------- b_03_rangesofnumericdatatypes: C# ----------
    //integral signed types - positive and negative values
    sbyte mySignedByteMin = sbyte.MinValue;
    sbyte mySignedByteMax = sbyte.MaxValue;

    short myInt16Min = short.MinValue;
    short myInt16Max = short.MaxValue;

    int myInt32Min = int.MinValue;
    int myInt32Max = int.MaxValue;

    long myInt64Min = long.MinValue;
    long myInt64Max = long.MaxValue;

    //integral unsigned types - only positive values
    byte myByteMin = byte.MinValue;
    byte myByteMax = byte.MaxValue;

    ushort myUnsignedInt16Min = ushort.MinValue;
    ushort myUnsignedInt16Max = ushort.MaxValue;

    uint myUnsignedInt32Min = uint.MinValue;
    uint myUnsignedInt32Max = uint.MaxValue;

    ulong myUnsignedInt64Min = ulong.MinValue;
    ulong myUnsignedInt64Max = ulong.MaxValue;

    //real numbers - always signed
    float myFloatingPtNumMin = float.MinValue;
    float myFloatingPtNumMax = float.MaxValue;

    double myDoublePrecisionNumMin = double.MinValue;
    double myDoublePrecisionNumMax = double.MaxValue;

    decimal myDecimalMin = decimal.MinValue;
    decimal myDecimalMax = decimal.MaxValue;

    Print("sbyte min: {0}, max: {1}, memory size [bytes]: {2}", mySignedByteMin, mySignedByteMax, sizeof(sbyte));
    Print("short min: {0}, max: {1}, memory size [bytes]: {2}", myInt16Min, myInt16Max, sizeof(short));
    Print("int min: {0}, max: {1}, memory size [bytes]: {2}", myInt32Min, myInt32Max, sizeof(int));
    Print("long min: {0}, max: {1}, memory size [bytes]: {2}", myInt64Min, myInt64Max, sizeof(long));
    Print("byte min: {0}, max: {1}, memory size [bytes]: {2}", myByteMin, myByteMax, sizeof(byte));
    Print("ushort min: {0}, max: {1}, memory size [bytes]: {2}", myUnsignedInt16Min, myUnsignedInt16Max, sizeof(ushort));
    Print("uint min: {0}, max: {1}, memory size [bytes]: {2}", myUnsignedInt32Min, myUnsignedInt32Max, sizeof(uint));
    Print("ulong min: {0}, max: {1}, memory size [bytes]: {2}", myUnsignedInt64Min, myUnsignedInt64Max, sizeof(ulong));
    Print("float min: {0}, max: {1}, memory size [bytes]: {2}", myFloatingPtNumMin, myFloatingPtNumMax, sizeof(float));
    Print("double min: {0}, max: {1}, memory size [bytes]: {2}", myDoublePrecisionNumMin, myDoublePrecisionNumMax, sizeof(double));
    Print("decimal min: {0}, max: {1}, memory size [bytes]: {2}", myDecimalMin, myDecimalMax, sizeof(decimal));
# ---------- end b_03_rangesofnumericdatatypes ----------

# ---- group: RH_OUT:numerical_data_ranges
text = Text(b_03_rangesofnumericdatatypes.out)

# ----
panel_2 = Panel(text)
