# Grasshopper definition HoppedUp_B_04_StringsCharacters.gh (Grasshopper 1.0.7)

panel = Panel()
default_string = GetString(panel, AtLeast=1, AtMost=1)
b_04_stringscharacters = B_04_StringsCharacters(str=default_string)  # -> out, A; inputs str: String
# ---------- b_04_stringscharacters: C# ----------
    char character = 'a';  //char stores a single Unicode character and occupies 2 bytes
    Print("character: " + character.ToString());

    char newLine = '\n';  //can store special characters too;

    //string represents an immutable sequence of Unicode characters (an array of chars)
    string someText1 = "Some text";
    string someText2 = @"Verbatim sign
      makes it possible
      to write multi-line text.";
    string someText3 = someText1 + newLine + someText2;

    Print(someText1);
    Print(someText2);
    Print(someText3);
# ---------- end b_04_stringscharacters ----------

# ---- group: RH_OUT:str_chars
text = Text(b_04_stringscharacters.out)

# ----
panel_2 = Panel(text)
