# Grasshopper definition HoppedUp_B_05_OtherTypes.gh (Grasshopper 1.0.7)

object_details = ObjectDetails(Object=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)  # -> Referenced, Available, Name, Layer, Colour, Guid; disabled
construct_date = ConstructDate(Year=2021, Month=10, Day=13, Hour=12, Minute=0, Second=0)  # disabled
guid = Guid(object_details.Guid)  # disabled
b_05_othertypes = B_05_OtherTypes()  # -> out, A; inputs someColour: Color, globalUniqueIdentifier: Guid; disabled
# ---------- b_05_othertypes: C# ----------
    //Complex is a structure from Grasshopper.Kernel.Types namespace;
    //DateTime is a structure from System namespace
    //Color is a structure from System.Drawing namespace
    //Guid is a structure from System namespace

    //all of these types are structures, so they are value types

    Print("complexNum is real: {0}", complexNum.IsReal);
    Print(dateAndTime.DayOfWeek.ToString());
    Print("Colour R: {0}, G: {1}, B: {2}", someColour.R, someColour.G, someColour.B);
    Print("Identifier: {0}", globalUniqueIdentifier.ToString());
# ---------- end b_05_othertypes ----------

create_complex = CreateComplex(Real=Slider(3, range=0..10), Imaginary=Slider(3, range=0..10))
complex_num = GetString(create_complex, AtLeast=1, AtMost=2147483647)
colors = GetString(ColourSwatch(SwatchColor=RGB(71, 166, 255)), AtLeast=1, AtMost=1)
b_05_othertypes_2 = B_05_OtherTypes(complexNum=complex_num, someColour=colors)  # -> out, A; inputs someColour: Color
# ---------- b_05_othertypes_2: C# usings ----------
using System.IO;
using System.Linq;
using System.Data;
using System.Drawing;
using System.Reflection;
using System.Windows.Forms;
using System.Xml;
using System.Xml.Linq;
using System.Runtime.InteropServices;

using Rhino.DocObjects;
using Rhino.Collections;
using GH_IO;
using GH_IO.Serialization;
# ---------- b_05_othertypes_2: C# ----------
    //Complex is a structure from Grasshopper.Kernel.Types namespace;
    //DateTime is a structure from System namespace
    //Color is a structure from System.Drawing namespace
    //Guid is a structure from System namespace

    //all of these types are structures, so they are value types

    Print("complexNum is real: {0}", complexNum.IsReal);
    //Print(dateAndTime.DayOfWeek.ToString());
    Print("Colour R: {0}, G: {1}, B: {2}", someColour.R, someColour.G, someColour.B);
    //Print("Identifier: {0}", globalUniqueIdentifier.ToString());
# ---------- end b_05_othertypes_2 ----------

# ---- group: RH_OUT:other_types
text = Text(b_05_othertypes_2.out)

# ----
panel = Panel(text)
