# Grasshopper definition HoppedUp_C_01_Point3DStructure.gh (Grasshopper 1.0.7)

numx = GetNumber(Slider(2, range=0..10), AtLeast=1, AtMost=1, Maximum=1.797693135e+308, Minimum=-1.797693135e+308)
numy = GetNumber(Slider(2, range=0..10), AtLeast=1, AtMost=1, Maximum=1.797693135e+308, Minimum=-1.797693135e+308)
numz = GetNumber(Slider(2, range=0..10), AtLeast=1, AtMost=1, Maximum=1.797693135e+308, Minimum=-1.797693135e+308)
c_01_point3dstructure = C_01_Point3DStructure(x=numx, y=numy, z=numz)  # -> out, point; inputs x: Double, y: Double, z: Double
# ---------- c_01_point3dstructure: C# usings ----------
using System.IO;
using System.Linq;
using System.Data;
using System.Drawing;
using System.Reflection;
using System.Windows.Forms;
using System.Xml;
using System.Xml.Linq;
using System.Runtime.InteropServices;

using Rhino.DocObjects;
using Rhino.Collections;
using GH_IO;
using GH_IO.Serialization;
# ---------- c_01_point3dstructure: C# ----------
    Point3d firstPoint = new Point3d(x, y, z);
    Print("firstPoint X: {0}, Y: {1}, Z: {2}", firstPoint.X, firstPoint.Y, firstPoint.Z);

    point = firstPoint;
# ---------- end c_01_point3dstructure ----------
rh_out_out = Text(c_01_point3dstructure.out)

# ---- group: RH_OUT:pt
point = Point(c_01_point3dstructure.point)

# ----
panel = Panel([rh_out_out, point])
