# Grasshopper definition HoppedUp_C_02_ReferenceAndValueTypes.gh (Grasshopper 1.0.7)

number_slider = Slider(2, range=0..10)
range = Range(Domain=Domain(0, 1), Steps=10)
construct_point = ConstructPoint(XCoordinate=range, YCoordinate=range, ZCoordinate=range)
construct_point_2 = ConstructPoint(XCoordinate=number_slider, YCoordinate=number_slider, ZCoordinate=number_slider)
polyline = PolyLine(Vertices=construct_point, Closed=False)
point = GetPoint(construct_point_2, AtLeast=1, AtMost=1, Realtime=True)
polyline_2 = GetGeometry(polyline, AtLeast=1, AtMost=1, Filter=1073741828)
c_02_referenceandvaluetypes = C_02_ReferenceAndValueTypes(myPoint=point, myPolyline=polyline_2)  # -> out, myPointOut, myPolylineOut, myPointCopyOut, myPolylineCopyOut; inputs myPoint: Point3d, myPolyline: Polyline
# ---------- c_02_referenceandvaluetypes: C# usings ----------
using System.IO;
using System.Linq;
using System.Data;
using System.Drawing;
using System.Reflection;
using System.Windows.Forms;
using System.Xml;
using System.Xml.Linq;
using System.Runtime.InteropServices;

using Rhino.DocObjects;
using Rhino.Collections;
using GH_IO;
using GH_IO.Serialization;
# ---------- c_02_referenceandvaluetypes: C# ----------
    Point3d myPointCopy = myPoint;    //copying all values to a different object
    Polyline myPolylineCopy = myPolyline;   //warning! this means a copy of reference, not a copy of an object
    //the statement above created another reference to the same data

    myPointCopy = myPointCopy + new Point3d(10, 10, 10);  //modifies only myPointCopy
    myPolylineCopy.RemoveAt(0);   //modifies a polyline referenced by myPolyline!
    //notice we changed only the copy, but also the main object has been modified! This is how reference types work
    // class -> reference
    // struct -> value

    myPointOut = myPoint;
    myPolylineOut = myPolyline;
    myPointCopyOut = myPointCopy;
    myPolylineCopyOut = myPolylineCopy;
# ---------- end c_02_referenceandvaluetypes ----------

# ---- group: RH_OUT:value_pt
point_2 = Point(c_02_referenceandvaluetypes.myPointOut)

# ---- group: RH_OUT:value_polyline
curve = Curve(c_02_referenceandvaluetypes.myPolylineOut)

# ---- group: RH_OUT:ref_pt
point_3 = Point(c_02_referenceandvaluetypes.myPointCopyOut)

# ---- group: RH_OUT:ref_polyline
curve_2 = Curve(c_02_referenceandvaluetypes.myPolylineCopyOut)
