# Grasshopper definition HoppedUp_D_02_NANInfinity!Infinity.gh (Grasshopper 1.0.7)

panel = Panel()
default = GetString(panel, AtLeast=1, AtMost=1)
d_02_naninfinity_infinity = D_02_NANInfinityInfinity(default=default)  # -> out, A
# ---------- d_02_naninfinity_infinity: C# ----------
    Print("double special values: \nNot a number: {0}\nPositiveInfinity: {1}\nNegativeInfinity: {2}", double.NaN, double.PositiveInfinity, double.NegativeInfinity);
# ---------- end d_02_naninfinity_infinity ----------

# ---- group: RH_OUT:NAN
text = Text(d_02_naninfinity_infinity.out)

# ----
panel_2 = Panel(text)
