# Grasshopper definition HoppedUp_D_08_ConditionalOperator.gh (Grasshopper 1.0.7)

intx = GetInteger(Slider(2, range=0..10), AtLeast=1, AtMost=1, Maximum=2147483647, Minimum=-2147483648)
d_08_conditionaloperator = D_08_ConditionalOperator(x=intx)  # -> out, notZero; inputs x: Int32
# ---------- d_08_conditionaloperator: C# ----------
    bool flag = false;
    flag = x != 0 ? true : false;
    
    //above instruction is equivalent to:
    // if(x!=0)
    //    flag = true;
    // else
    //    flag = false;
    
    // ...it is an elegant alternative
    
    notZero = flag;
# ---------- end d_08_conditionaloperator ----------

# ---- group: RH_OUT:bool
boolean = Boolean(d_08_conditionaloperator.notZero)

# ----
panel = Panel(boolean)
