# Grasshopper definition HoppedUp_D_09_ToggleSwitchAB.gh (Grasshopper 1.0.7)

toggle = GetNumber(Toggle(True), AtLeast=1, AtMost=1, Maximum=1.797693135e+308, Minimum=-1.797693135e+308)
val_stringa = GetString("test content 1", AtLeast=1, AtMost=1)
val_stringb = GetString("test content 2", AtLeast=1, AtMost=1)
d_09_toggleswitchab = D_09_ToggleSwitchAB(toggle=toggle, valA=val_stringa, valB=val_stringb)  # -> out, result; inputs toggle: Boolean
# ---------- d_09_toggleswitchab: C# ----------
    result = toggle ? valA : valB;
# ---------- end d_09_toggleswitchab ----------

# ---- group: RH_OUT:switch
data = Data(d_09_toggleswitchab.result)

# ----
panel = Panel(data)
