# Grasshopper definition HoppedUp_D_10_Precedence.gh (Grasshopper 1.0.7)

numx = GetNumber(Slider(2.99, range=0..10), AtLeast=1, AtMost=1, Maximum=1.797693135e+308, Minimum=-1.797693135e+308)
numy = GetNumber(Slider(1.02, range=0..10), AtLeast=1, AtMost=1, Maximum=1.797693135e+308, Minimum=-1.797693135e+308)
numz = GetNumber(Slider(8.49, range=0..10), AtLeast=1, AtMost=1, Maximum=1.797693135e+308, Minimum=-1.797693135e+308)
d_10_precedence = D_10_Precedence(x=numx, y=numy, z=numz)  # -> out; inputs x: Double, y: Double, z: Double
# ---------- d_10_precedence: C# ----------
    Print("x + y / z = {0}", x + y / z);
    Print("(x + y) / z = {0}", (x + y) / z);
    Print("x + y / z++ = {0}", x + y / z++);
    Print("z after last operation = {0}", z);
    Print("z--... = {0}", --z);
    Print("(x + y) / ++z = {0}", x + y / ++z);
# ---------- end d_10_precedence ----------

# ---- group: RH_OUT:presidence
text = Text(d_10_precedence)

# ----
panel = Panel(text)
