# Grasshopper definition HoppedUp_E_06_QuadraticEquation.gh (Grasshopper 1.0.7)

parama = GetNumber(Slider(4, range=0..10), AtLeast=1, AtMost=1, Maximum=1.797693135e+308, Minimum=-1.797693135e+308)
paramb = GetNumber(Slider(5, range=0..10), AtLeast=1, AtMost=1, Maximum=1.797693135e+308, Minimum=-1.797693135e+308)
paramc = GetNumber(Slider(1, range=0..10), AtLeast=1, AtMost=1, Maximum=1.797693135e+308, Minimum=-1.797693135e+308)
e_06_quadraticequation = E_06_QuadraticEquation(paramA=parama, paramB=paramb, paramC=paramc)  # -> out, del, x1, x2; inputs paramA: Double, paramB: Double, paramC: Double
# ---------- e_06_quadraticequation: C# usings ----------
using System.IO;
using System.Linq;
using System.Data;
using System.Drawing;
using System.Reflection;
using System.Windows.Forms;
using System.Xml;
using System.Xml.Linq;
using System.Runtime.InteropServices;

using Rhino.DocObjects;
using Rhino.Collections;
using GH_IO;
using GH_IO.Serialization;
# ---------- e_06_quadraticequation: C# ----------
    char pow2 = '\u00B2';
    Print("Equation: {0}x{3} + {1}x + {2}", paramA, paramB, paramC, pow2);

    if(paramA == 0)
    {
      Print("This is not a quadratic equation!");
      // this is how you can add some warnings or remarks:
      Component.AddRuntimeMessage(GH_RuntimeMessageLevel.Error, "This is not a quadratic equation!");
      return; // return means quitting execution
    }
    else
    {
      double delta = Math.Pow(paramB, 2) - 4 * paramA * paramC;
      del = delta;

      if(delta < 0)
      {
        Print("Delta < 0. No real number solution!");
        Component.AddRuntimeMessage(GH_RuntimeMessageLevel.Warning, "Delta < 0. No real number solution!");
        return;
      }
      else if(delta == 0)
      {
        Print("Delta == 0. Single solution.");
        Component.AddRuntimeMessage(GH_RuntimeMessageLevel.Remark, "Delta == 0. Single solution.");
        x1 = x2 = -paramB / (2 * paramA);
      }
      else
      {
        Print("Delta > 0. Two solutions.");
        x1 = -paramB - Math.Sqrt(delta) / (2 * paramA);
        x2 = -paramB + Math.Sqrt(delta) / (2 * paramA);
      }
    }
# ---------- end e_06_quadraticequation ----------

# ---- group: RH_OUT:x2
number = Number(e_06_quadraticequation.x2)

# ---- group: RH_OUT:equation_delta
text = Text(e_06_quadraticequation.out)

# ---- group: RH_OUT:del
number_2 = Number(e_06_quadraticequation.del)

# ---- group: RH_OUT:x1
number_3 = Number(e_06_quadraticequation.x1)

# ----
panel = Panel(text)
panel_2 = Panel(number_2)
panel_3 = Panel(number_3)
panel_4 = Panel(number)
