# Grasshopper definition HoppedUp_E_7_CaseSwitchStatement.gh (Grasshopper 1.0.7)

# How to use the new HOPS component
number_slider = Slider(0, range=0..10)
intx = GetInteger(number_slider, AtLeast=1, AtMost=1, Maximum=2147483647, Minimum=-2147483648)
e_7_caseswitchstatement = E_7_CaseSwitchStatement(x=intx)  # -> out, letter; inputs x: Int32
# ---------- e_7_caseswitchstatement: C# ----------
    switch(x)
    {
      case 0: letter = 'a';
        break;
      case 1: letter = 'b';
        break;
      case 2: letter = 'c';
        break;
      case 3: letter = 'd';
        break;
      default: letter = "No match!";
        Component.AddRuntimeMessage(GH_RuntimeMessageLevel.Warning, "Unpredicted result!");
        break;
    }
# ---------- end e_7_caseswitchstatement ----------

# ---- group: RH_OUT:case_switch
text = Text(e_7_caseswitchstatement.letter)

# ----
panel = Panel(text)
