# Grasshopper definition HoppedUp_F_02_PsuedoSeriesLoop.gh (Grasshopper 1.0.7)

start = GetInteger(Slider(0, range=0..10), AtLeast=1, AtMost=1, Maximum=2147483647, Minimum=-2147483648)
step = GetInteger(Slider(1, range=0..10), AtLeast=1, AtMost=1, Maximum=2147483647, Minimum=-2147483648)
count = GetInteger(Slider(10, range=0..10), AtLeast=1, AtMost=1, Maximum=2147483647, Minimum=-2147483648)
f_02_psuedoseriesloop = F_02_PsuedoSeriesLoop(start=start, step=step, count=count)  # -> out, A; inputs start: Int32, step: Int32, count: Int32
# ---------- f_02_psuedoseriesloop: C# usings ----------
using System.IO;
using System.Linq;
using System.Data;
using System.Drawing;
using System.Reflection;
using System.Windows.Forms;
using System.Xml;
using System.Xml.Linq;
using System.Runtime.InteropServices;

using Rhino.DocObjects;
using Rhino.Collections;
using GH_IO;
using GH_IO.Serialization;
# ---------- f_02_psuedoseriesloop: C# ----------
    for(int i = 0; i < count; i++)
    {
      A = i * step + start + 1;
      Print("i: {0}, A = {1}", i, A);
    }
# ---------- end f_02_psuedoseriesloop ----------

# ---- group: RH_OUT:pseudo_series_loop
text = Text(f_02_psuedoseriesloop.out)

# ---- group: RH_OUT:amount
integer = Integer(f_02_psuedoseriesloop.A)

# ----
panel = Panel(text)
panel_2 = Panel(integer)
