# Grasshopper definition HoppedUp_P_04_bubbleSortingExerciseOtherWay.gh (Grasshopper 1.0.7)

gene_pool = GenePool(
    Decimals=2,
    Maximum=10,
    Minimum=0,
    Value=[7.906020059, 8.122275545, 4.353265629, 7.22788643, 1.725925585, 1.994836848, 8.137506614, 8.844055547, 5.308609607, 6.586406257, 9.738256219, 3.489777615, 2.110042578, 7.778574418, 1.924390584, 0.9066347922, 7.94497711, 1.222852124, 5.911592038, 5.106070743])
reset = GetInteger(Toggle(False), AtLeast=1, AtMost=1, Maximum=2147483647, Minimum=-2147483648)
run = GetInteger(Toggle(True), AtLeast=1, AtMost=1, Maximum=2147483647, Minimum=-2147483648)
values = GetNumber(gene_pool, AtLeast=1, AtMost=1, Maximum=1.797693135e+308, Minimum=-1.797693135e+308)
p_04_bubblesortingexerciseotherway = P_04_bubbleSortingExerciseOtherWay(reset=reset, run=run, values=values)  # -> out, A; inputs reset: Boolean, run: Boolean, values: list of Double
# ---------- p_04_bubblesortingexerciseotherway: C# usings ----------
using System.IO;
using System.Linq;
using System.Data;
using System.Drawing;
using System.Reflection;
using System.Windows.Forms;
using System.Xml;
using System.Xml.Linq;
using System.Runtime.InteropServices;

using Rhino.DocObjects;
using Rhino.Collections;
using GH_IO;
using GH_IO.Serialization;
# ---------- p_04_bubblesortingexerciseotherway: C# ----------
    Component.Message = "Bubble sorting visualisation";
    List<GH_Point> ptList = new List<GH_Point>(values.Count);

    if(reset)
    {
      minIndex = values.Count - 1;
      scriptValues = values;
    }
    else if(run && minIndex >= 1)
    {
      double temp = 0;
      for(int i = values.Count - 1; i >= minIndex; i--)
      {
        for(int j = 0; j < i; j++)
        {
          if(values[j] > values[j + 1])
          {
            temp = values[j];
            values[j] = values[j + 1];
            values[j + 1] = temp;
          }
        }
      }
      minIndex--;
      scriptValues = values;
      Component.ExpireSolution(true);
    }
    for(int i = 0; i < scriptValues.Count; i++)
      ptList.Add(new GH_Point(new Point3d(scriptValues[i], i, 0)));

    A = ptList;
# ---------- p_04_bubblesortingexerciseotherway: C# additional code ----------
  int minIndex;
  List<double> scriptValues;
# ---------- end p_04_bubblesortingexerciseotherway ----------

# ---- group: RH_OUT:points
point = Point(p_04_bubblesortingexerciseotherway.A)

# ----
panel = Panel(point)
