# Grasshopper definition HoppedUp_P_05_ElapsedStopwatchExercise.gh (Grasshopper 1.0.7)

count = GetInteger(Slider(11, range=0..100), AtLeast=1, AtMost=1, Maximum=2147483647, Minimum=-2147483648)
p_05_elapsedstopwatchexercise = P_05_ElapsedStopwatchExercise(count=count)  # -> out, pointList; inputs count: Int32
# ---------- p_05_elapsedstopwatchexercise: C# usings ----------
using System.IO;
using System.Linq;
using System.Data;
using System.Drawing;
using System.Reflection;
using System.Windows.Forms;
using System.Xml;
using System.Xml.Linq;
using System.Runtime.InteropServices;

using Rhino.DocObjects;
using Rhino.Collections;
using GH_IO;
using GH_IO.Serialization;
# ---------- p_05_elapsedstopwatchexercise: C# ----------
    System.Diagnostics.Stopwatch st = System.Diagnostics.Stopwatch.StartNew();

    List<Point3d> pts = new List<Point3d>(count);
    for(int i = 0; i < count; i++)
      pts.Add(new Point3d(i, i, i));
    pointList = pts;
    st.Stop();

    Component.Message = "List<Point3d> + init cap: " + st.ElapsedMilliseconds.ToString() + "ms";
# ---------- end p_05_elapsedstopwatchexercise ----------

# ---- group: RH_OUT:point_list
point = Point(p_05_elapsedstopwatchexercise.pointList)
