# Grasshopper definition HopperUp_Trusses_Espinales_2021.gh (Grasshopper 1.0.7)

# plug in any two parallel curves
# to see structure built
number_slider = Slider(12, range=0..100)
unit_x = UnitX(Factor=number_slider)
construct_point = ConstructPoint(XCoordinate=0, YCoordinate=0, ZCoordinate=0)
move = Move(Geometry=construct_point, Motion=unit_x)  # -> Geometry, Transform
polar_array = PolarArray(Geometry=construct_point, Plane=PlaneXY(0, 0, 0), Count=10, Angle=6.283185307)  # -> Geometry, Transform
polar_array_2 = PolarArray(Geometry=move.Geometry, Plane=PlaneXY(0, 0, 0), Count=10, Angle=6.283185307)  # -> Geometry, Transform
first_point = GetPoint(construct_point, AtLeast=1, AtMost=1, Realtime=True)
second_point = GetPoint(move.Geometry, AtLeast=1, AtMost=1, Realtime=True)

# ---- group: Arch Params
spans = Slider(17, range=0..100)
void = Slider(3, range=0..10)
width = Slider(6, range=0..20)
depth = Slider(8, range=0..20)
height = Slider(3, range=0..20)
number_slider_2 = Slider(0.183, range=0..1)
number_slider_3 = Slider(0.48, range=0..10)

# ----
# Set Two Planar Points
point = Point(first_point)
point_2 = Point(second_point)

height_2 = GetInteger(height, AtLeast=1, AtMost=1, Maximum=2147483647, Minimum=-2147483648)
depth_2 = GetInteger(depth, AtLeast=1, AtMost=2147483647, Maximum=2147483647, Minimum=-2147483648)
width_2 = GetInteger(width, AtLeast=1, AtMost=1, Maximum=2147483647, Minimum=-2147483648)
spans_2 = GetInteger(spans, AtLeast=1, AtMost=2147483647, Maximum=2147483647, Minimum=-2147483648)
void_2 = GetInteger(void, AtLeast=1, AtMost=1, Maximum=2147483647, Minimum=-2147483648)
radiipipe = GetNumber(number_slider_3, AtLeast=1, AtMost=1, Maximum=1.797693135e+308, Minimum=-1.797693135e+308)
radiispanpipe = GetNumber(number_slider_2, AtLeast=1, AtMost=2147483647, Maximum=1.797693135e+308, Minimum=-1.797693135e+308)

distance = Distance(PointA=point, PointB=point_2)
division = Division(A=distance, B=height_2)
division_2 = Division(A=distance, B=depth_2)
division_3 = Division(A=distance, B=width_2)
height_3 = Number(division)
depth_3 = Number(division_2)
width_3 = Number(division_3)

line = Line(StartPoint=point, EndPoint=point_2)
get_number = GetNumber("0.5", AtLeast=1, AtMost=1, Maximum=1.797693135e+308, Minimum=-1.797693135e+308)
evaluate_curve = EvaluateCurve(Curve=line, Parameter=get_number)  # -> Point, Tangent, Angle
unit_z = UnitZ(Factor=height_3)
unit_z_2 = UnitZ(Factor=depth_3)
move_2 = Move(Geometry=evaluate_curve.Point, Motion=unit_z)  # -> Geometry, Transform
plane_3pt = Plane3Pt(PointA=point, PointB=point_2, PointC=move_2.Geometry)

# ---- group: Maths for top arches
expression = Expression(w=width_3, Expression="-w/2")
expression_2 = Expression(w=width_3, Expression="w/2")
deconstruct_plane = DeconstructPlane(Plane=plane_3pt)  # -> Origin, XAxis, YAxis, ZAxis
multiplication = Multiplication(A=deconstruct_plane.ZAxis, B=expression_2)
multiplication_2 = Multiplication(A=deconstruct_plane.ZAxis, B=expression)
addition = Addition(A=unit_z_2, B=multiplication)
addition_2 = Addition(A=unit_z_2, B=multiplication_2)
vector_display = VectorDisplay(Vector=[addition_2, addition])

# ----
interpolate = Interpolate(Vertices=[point_2, move_2.Geometry, point], Degree=3, Periodic=False, KnotStyle=1)  # -> Curve, Length, Domain
move_3 = Move(Geometry=move_2.Geometry, Motion=addition)  # -> Geometry, Transform
move_4 = Move(Geometry=move_2.Geometry, Motion=addition_2)  # -> Geometry, Transform
interpolate_2 = Interpolate(Vertices=[point_2, move_3.Geometry, point], Degree=3, Periodic=False, KnotStyle=1)  # -> Curve, Length, Domain
interpolate_3 = Interpolate(Vertices=[point_2, move_4.Geometry, point], Degree=3, Periodic=False, KnotStyle=1)  # -> Curve, Length, Domain

# ---- group: arch geomrtries
top_right_arch = Curve(interpolate_3.Curve)
top_left_arch = Curve(interpolate_2.Curve)
base_arch = Curve(interpolate.Curve)

# ----
divide_curve = DivideCurve(Curve=base_arch, Count=spans_2, Kinks=False)  # -> Points, Tangents, Parameters
divide_curve_2 = DivideCurve(Curve=top_left_arch, Count=spans_2, Kinks=False)  # -> Points, Tangents, Parameters
divide_curve_3 = DivideCurve(Curve=top_right_arch, Count=spans_2, Kinks=False)  # -> Points, Tangents, Parameters

# ---- group: List Data Manipulation
subtraction = Subtraction(A=spans_2, B=void_2)
construct_domain = ConstructDomain(DomainStart=void_2, DomainEnd=subtraction)
sub_list = SubList(List=divide_curve.Points, Domain=construct_domain, Wrap=True)  # -> List, Index
sub_list_2 = SubList(List=divide_curve_2.Points, Domain=construct_domain, Wrap=True)  # -> List, Index
sub_list_3 = SubList(List=divide_curve_3.Points, Domain=construct_domain, Wrap=True)  # -> List, Index
panel = Panel("""False
True""")
panel_2 = Panel("""True
False""")
panel_3 = Panel("""True
False""")
cull_pattern = CullPattern(List=sub_list.List, CullPattern=panel)
cull_pattern_2 = CullPattern(List=sub_list_2.List, CullPattern=panel_2)
cull_pattern_3 = CullPattern(List=sub_list_3.List, CullPattern=panel_3)
panel_4 = Panel("""1
0""")
panel_5 = Panel("""1
0""")
weave = Weave(Pattern=panel_4, Stream0=cull_pattern, Stream1=cull_pattern_3, NullGaps=False)
weave_2 = Weave(Pattern=panel_5, Stream0=cull_pattern, Stream1=cull_pattern_2, NullGaps=False)

# ---- group: RH_OUT:finalGeo1
polyline = PolyLine(Vertices=weave_2, Closed=False)

# ---- group: RH_OUT:finalGeo2
polyline_2 = PolyLine(Vertices=weave, Closed=False)

# ---- group: RH_OUT:finalGeo3
line_2 = Line(StartPoint=cull_pattern_2, EndPoint=cull_pattern_3)

# ----
explode = Explode(Curve=polyline, Recursive=True)  # -> Segments, Vertices
explode_2 = Explode(Curve=polyline_2, Recursive=True)  # -> Segments, Vertices

# ---- group: RH_OUT:pipe
pipe = Pipe(Curve=[base_arch, top_left_arch, top_right_arch], Radius=radiipipe, Caps=0)

# ---- group: RH_OUT:spanPipes
pipe_2 = Pipe(Curve=[explode_2.Segments, explode.Segments, line_2], Radius=radiispanpipe, Caps=0)

# ----
final_rendered_structure = Geometry([pipe, pipe_2])
